% Simulink data dictionary neck_mk3.sldd

MCU_Ts = 0.001
PWM_frequency = 20000

Data_ControlCommands = Simulink.Bus()
  Voltage: single[3], Min=-100, Max=100, Unit="%"  % Actuation voltage signals.

Data_ControlFeedback = Simulink.Bus()
  Encoders: single[3], Unit="deg"

Data_JointReferences = Simulink.Bus()
  SetPoints: single[3], Unit="deg"  % Setpoints that the system needs to track.

Data_Measurements = Simulink.Bus()
  Encoders: single[3], Unit="deg"

Vcc = 12

Physical_Phases = Simulink.ConnectionBus()
  Motor1_Pos: Connection: foundation.electrical.electrical
  Motor1_Neg: Connection: foundation.electrical.electrical
  Motor2_Pos: Connection: foundation.electrical.electrical
  Motor2_Neg: Connection: foundation.electrical.electrical
  Motor3_Pos: Connection: foundation.electrical.electrical
  Motor3_Neg: Connection: foundation.electrical.electrical

Physical_MechRotationals = Simulink.ConnectionBus()
  Motor1_R: Connection: foundation.mechanical.rotational.rotational
  Motor1_C: Connection: foundation.mechanical.rotational.rotational
  Motor2_R: Connection: foundation.mechanical.rotational.rotational
  Motor2_C: Connection: foundation.mechanical.rotational.rotational
  Motor3_R: Connection: foundation.mechanical.rotational.rotational
  Motor3_C: Connection: foundation.mechanical.rotational.rotational

Physical_Environment = Simulink.ConnectionBus()
  Env: Connection: simmechanics.connections.frame