test file "test_req"

suite "Test Neck Mk2"

  case "Test Range of Motion (ROM) payload ergoCub head" [simulation]
    model arch_logical, harness arch_logical_Harness_ReqTest_FR_7
    parameter set "Parameter Set 1": TestVariantConfiguration = "Variant_NeckMk2_ergoCub"  % model workspace
    post-load callback:
      sltest.harness.open(sltest_sut, sltest_bdroot);

  case "Test Range of Motion (ROM) payload iCub head" [simulation]
    model arch_logical, harness arch_logical_Harness_ReqTest_FR_7
    parameter set "Parameter Set 1": TestVariantConfiguration = "Variant_NeckMk2_iCub"  % model workspace
    post-load callback:
      sltest.harness.open(sltest_sut, sltest_bdroot);